# Grasshopper definition 230419_Asymptotic_Tower_optiL0_0._0.gh (Grasshopper 1.0.7)
# plug-ins: GH_MinSurf, Pufferfish, Kangaroo2 Components, goat, Karamba3D, Sturnella

number_slider = Slider(6, range=5..7)
number_slider_2 = Slider(0.1, range=0.1..1.1)
number_slider_3 = Slider(0.3, range=0.1..1.1)

pt = ConstructPoint(XCoordinate=0, YCoordinate=0, ZCoordinate=0)
pt_2 = ConstructPoint(XCoordinate=0, YCoordinate=0, ZCoordinate=number_slider)
circle = CircleCNR(Center=pt_2, Normal=Vector(0, 0, 1), Radius=number_slider_2)
circle_2 = CircleCNR(Center=pt, Normal=Vector(0, 0, 1), Radius=number_slider_3)

goat = Goat(fitness=num_2, gene=number_slider_2)
minsurf_2c = MinimalSurface(C0Curve=circle_2, C1Curve=circle, UCount=20, VCount=20, Itteration=20, SurfaceUDegree=3, SurfaceVDegree=3)  # -> UVPointGrid, ResultingSurface
minimalsurface = Surface(minsurf_2c.ResultingSurface)

asymptoticcount = Slider(5, range=2..30)

merge = Merge(Data1=number_slider_3, Data2=number_slider_2, Data3=number_slider, Data5=asymptoticcount)
panel = Panel(merge)
merge_2 = Merge(Data1=merge)
minimalsurface_2 = Surface(minimalsurface)
pt_3 = ConstructPoint(XCoordinate=0, YCoordinate=0, ZCoordinate=0)
circle_3 = CircleCNR(Center=pt_3, Normal=Vector(0, 0, 1), Radius=1)
# 3D Geo
number_slider_4 = Slider(7.9, range=0..10)
pt_4 = ConstructPoint(XCoordinate=0, YCoordinate=0, ZCoordinate=0)
num = Number(5.139066063)
circle_4 = CircleCNR(Center=pt_4, Normal=Vector(0, 0, 1), Radius=num)
number_slider_5 = Slider(7.2, range=0..10)
license = LicenseKaramba3D()
panel_2 = Panel(license)
multiplication = Multiplication(A=asymptoticcount, B="2")
sturnella = Sturnella(
    SturnellaChunkName_TotalElapsedTime=5869914058,
    SturnellaChunkName_DataDumpObjectiveGuid=[energy, lenght_laths, no_joints, displacement],
    SturnellaChunkName_DataDumpParameterGuid=[number_slider_3, number_slider_2, asymptoticcount],
    SturnellaChunkName_OptimizationParams_OptimizationParams_HidePreview=False,
    SturnellaChunkName_OptimizationParams_OptimizationParams_Hours=0,
    SturnellaChunkName_OptimizationParams_OptimizationParams_HypercubeFitnessDividend=10,
    SturnellaChunkName_OptimizationParams_OptimizationParams_IsTimeConstrained=False,
    SturnellaChunkName_OptimizationParams_OptimizationParams_Iterations=10,
    SturnellaChunkName_OptimizationParams_OptimizationParams_Minutes=0,
    SturnellaChunkName_OptimizationParams_OptimizationParams_MutationRate=0.5,
    SturnellaChunkName_OptimizationParams_OptimizationParams_PopulationSize=50,
    SturnellaChunkName_OptimizationParams_OptimizationParams_RepositorySize=250,
    SturnellaChunkName_OptimizationParams_OptimizationParams_SolutionSpaceDims=4,
    SturnellaChunkName_OptimizationParams_OptimizationParams_SolutionSpaceDivisors=10,
    SturnellaChunkName_Swarm_Swarm_CurrentIteration=0,
    SturnellaChunkName_Swarm_Swarm_CurrentParticle=2,
    SturnellaChunkName_Swarm_Swarm_CurrentSwarm=3,
    SturnellaChunkName_Swarm_Swarm_Particle0_Particle_CurrentSolution0_Solution_Hypercube=-1,
    SturnellaChunkName_Swarm_Swarm_Particle0_Particle_CurrentSolution0_Solution_Position=[0.3138682712, 0.9807783988, 18.36073692],
    SturnellaChunkName_Swarm_Swarm_Particle0_Particle_CurrentSolution0_Solution_Value=[7.484114955e-06, 292.7991873, 720, 0.01210389083],
    SturnellaChunkName_Swarm_Swarm_Particle1_Particle_CurrentSolution1_Solution_Hypercube=-1,
    SturnellaChunkName_Swarm_Swarm_Particle1_Particle_CurrentSolution1_Solution_Position=[0.1118462094, 0.8306865234, 20.84374289],
    SturnellaChunkName_Swarm_Swarm_Particle1_Particle_CurrentSolution1_Solution_Value=[2.614795565e-05, 262.9179578, 490, 0.04716392482],
    SturnellaChunkName_Swarm_Swarm_Particle2_Particle_CurrentSolution2_Solution_Hypercube=-1,
    SturnellaChunkName_Swarm_Swarm_Particle2_Particle_CurrentSolution2_Solution_Position=[0.7933685954, 0.1501335832, 20.59862637],
    SturnellaChunkName_Swarm_Swarm_Particle3_Particle_CurrentSolution3_Solution_Hypercube=-1,
    SturnellaChunkName_Swarm_Swarm_Particle3_Particle_CurrentSolution3_Solution_Position=[0.134138815, 0.7164934973, 19.31592427],
    SturnellaChunkName_Swarm_Swarm_Particle4_Particle_CurrentSolution4_Solution_Hypercube=-1,
    SturnellaChunkName_Swarm_Swarm_Particle4_Particle_CurrentSolution4_Solution_Position=[0.2235497669, 0.5045576832, 19.06936755],
    SturnellaChunkName_Swarm_Swarm_Particle5_Particle_CurrentSolution5_Solution_Hypercube=-1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)
# knit fabric is 2mm thick with weight of 0.076g/cm^2
# 
# 7.2mx1m = 7.2m2 = 7.2 x100x100cm2 = 72000cm2
# 
# 72000cm2 x 0.076g = 5,472g = 5.472kg = 0.0537 kN
panel_3 = Panel("""70mph = 31n/s
=  577Pa =  0.577 Kn/m2""")
list = ValueList({"LoadCase0 (1.4D)": 0, "LoadCase1 (0.9D+ 1.0W)": 1, "LoadCase2 (1.2D + 1.6LL1)": 2, "LoadCase3(1.2D + 1.6LL2)": 3}, selected="LoadCase0 (1.4D)")
license_2 = LicenseKaramba3D()
swatch = ColourSwatch(SwatchColor=RGB(0, 0, 255))
panel_4 = Panel(license_2)
merge_3 = Merge(
    Data1=swatch,
    Data2=swatch,
    Data3=swatch,
    Data4=swatch,
    Data5=swatch,
    Data6=swatch,
    Data7=swatch,
    Data8=ColourSwatch(SwatchColor=RGB(0, 0, 255)),
    Data9=ColourSwatch(SwatchColor=RGB(0, 0, 255)),
    Data10=ColourSwatch(SwatchColor=RGB(0, 178, 255)),
    Data11=ColourSwatch(SwatchColor=RGB(0, 255, 255)),
    Data12=ColourSwatch(SwatchColor=RGB(0, 255, 179)),
    Data13=ColourSwatch(SwatchColor=RGB(0, 255, 0)),
    Data14=ColourSwatch(SwatchColor=RGB(178, 255, 0)),
    Data15=ColourSwatch(SwatchColor=RGB(255, 255, 0)),
    Data16=ColourSwatch(SwatchColor=RGB(255, 178, 0)),
    Data17=ColourSwatch(SwatchColor=RGB(255, 0, 0)))
mergef = MergeFields()

number_slider_6 = Slider(0.0045, range=0..0.01)
# ANALYSIS TOOLS
# _________________
inframe_geodesics = Geometry()  # disabled
youngsmodulus = Panel("9100")  # disabled
sigmaf = Panel("45")  # disabled

# ----
# Prestress Calculations lath
inframe_geodesics_2 = Curve(reparameterize(flatten(inframe_geodesics)))  # disabled
unique_geodesics = Curve(simplify(graft(inframe_geodesics_2)))  # disabled
number_slider_7 = Slider(100, range=0..100)  # disabled
crv = Curve(unique_geodesics)  # disabled
divide = DivideCurve(Curve=crv, Count=number_slider_7, Kinks=False)  # -> Points, Tangents, Parameters; disabled
curvature = Curvature(Curve=crv, Parameter=divide.Parameters)  # -> P, K, C; disabled
darc = DeconstructArc(Arc=curvature.C)  # -> BasePlane, Radius, Angle; disabled
sort = SortList(Keys=flatten(darc.Radius))  # -> Keys, ValuesA; disabled
avr = Average(Input=darc.Radius)  # -> simplify(ArithmeticMean); disabled
item = ListItem(List=sort.Keys, Index=0, Wrap=True)  # disabled
min_radius = Panel(item)  # disabled
panel_5 = Panel(avr)  # disabled
expression = Expression(sigmaf=sigmaf, z=number_slider_6, E=youngsmodulus, r=panel_5, Expression="E/sigmaf*z/r")  # disabled
panel_6 = Panel(expression)  # disabled
number_slider_8 = Slider(100, range=0..100)  # disabled
multiplication_2 = Multiplication(A=panel_6, B=number_slider_8)  # disabled
int = Integer(multiplication_2)  # disabled

sort_2 = SortList(Keys=darc.Radius)  # -> Keys, ValuesA; disabled
item_2 = ListItem(List=sort_2.Keys, Index=0, Wrap=True)  # disabled
expression_2 = Expression(z=number_slider_6, E=youngsmodulus, r=avr, Expression="E*z/r")  # disabled
expression_3 = Expression(z=number_slider_6, E=youngsmodulus, r=item_2, Expression="E*z/r")  # disabled
maxmimum_bending_stress = Data(expression_3)  # disabled
average_bending_stress = Data(expression_2)  # disabled
min_radius_2 = Data(min_radius)  # disabled

average_bending_stress_2 = Data(average_bending_stress)  # disabled
av_utilization = Data(int)  # disabled
maxmimum_bending_stress_2 = Data(maxmimum_bending_stress)  # disabled
min_radius_3 = Data(min_radius_2)  # disabled

expression_4 = Expression(x=maxmimum_bending_stress_2, sigmaf=sigmaf, Expression="(x/sigmaf)*100")  # disabled
avergae_bending_stress = Panel(expression_4)  # disabled
maxmimum_bending_stress_3 = Panel(maxmimum_bending_stress_2)  # disabled
bnd = Bounds(Numbers=flatten(maxmimum_bending_stress_3))  # disabled
dedomain = DeconstructDomain(Domain=bnd)  # -> Start, End; disabled
panel_7 = Panel(dedomain.End)  # disabled
panel_8 = Panel(dedomain.Start)  # disabled

debrep = DeconstructBrep(Brep=minimalsurface)  # -> Faces, Edges, Vertices
item_3 = ListItem(List=debrep.Edges, Index=0, Wrap=True)  # -> Item, Item1
divide_2 = DivideCurve(Curve=item_3.Item1, Count=asymptoticcount, Kinks=False)  # -> Points, Tangents, Parameters
pt_5 = Point(divide_2.Points)
srf_cp = SurfaceCP(Point=pt_5, Surface=minimalsurface)  # -> Point, UVPoint, Distance

# ----
# Asymptotic Lines
# faster (no data output)
angle = Slider(0, range=-90..90)
panel_9 = Panel("""True
False""")
rad = Radians(Degrees=angle)
vb = VBScript(srf=minimalsurface, uv=srf_cp.UVPoint, accuracy=Slider(0.005, range=0..0.01), angle=rad, max=graft(panel_9))  # -> out, pts; inputs srf: Surface, uv: Point3d
# ---------- vb: VB usings ----------
Imports System.IO
Imports System.Linq
Imports System.Data
Imports System.Drawing
Imports System.Reflection
Imports System.Windows.Forms
Imports System.Xml
Imports System.Xml.Linq
Imports Microsoft.VisualBasic
Imports System.Runtime.InteropServices

Imports Rhino.DocObjects
Imports Rhino.Collections
Imports GH_IO
Imports GH_IO.Serialization
# ---------- vb: VB ----------
    If (srf Is Nothing) Then Return
    If (Not uv.IsValid) Then Return

    'Limit the accuracy to the document tolerance.
    accuracy = Math.Max(accuracy, doc.ModelAbsoluteTolerance)

    'Declare our list of samples.
    Dim dir0 As List(Of Point3d) = SampleCurvature(srf, uv, accuracy, max, angle)
    Dim dir1 As List(Of Point3d) = SampleCurvature(srf, uv, accuracy, max, angle + Math.PI)

    'Remove the first point in dir1 as it's a duplicate
    dir1.RemoveAt(0)
    dir1.Reverse()

    dir1.AddRange(dir0)
    pts = dir1
# ---------- vb: VB additional code ----------
  Private Function SampleCurvature(ByVal srf As Surface, ByVal uv As Point3d, ByVal accuracy As Double, ByVal max As Boolean, ByVal angle As Double) As List(Of Point3d)
    Dim p As Point3d = uv
    Dim U As Interval = srf.Domain(0)
    Dim V As Interval = srf.Domain(1)

    Dim samples As New List(Of Point3d)
    Do
      'Abort if we've added more than 10,000 samples
      If (samples.Count > 10000) Then Exit Do

      'Get the curvature at the current point
      Dim crv As SurfaceCurvature = srf.CurvatureAt(p.X, p.Y)
      If (crv Is Nothing) Then Exit Do

      'Add the current point
      samples.Add(srf.PointAt(p.X, p.Y))

      'Get the maximum principal direction & values
      Dim dir As Vector3d
      Dim k1 = 0
      Dim k2 = 0
      If (crv.Kappa(0) > crv.Kappa(1)) Then
        If (max) Then
          dir = crv.Direction(0)
          k1 = crv.Kappa(0)
          k2 = crv.Kappa(1)
        Else
          dir = crv.Direction(1)
          k1 = crv.Kappa(1)
          k2 = crv.Kappa(0)
        End If
      Else
        If (max) Then
          dir = crv.Direction(1)
          k1 = crv.Kappa(1)
          k2 = crv.Kappa(0)
        Else
          dir = crv.Direction(0)
          k1 = crv.Kappa(0)
          k2 = crv.Kappa(1)
        End If
      End If


      'check if you are on an anticlastic surface, if not: Exit
      If (k1 * k2 > 0) Then Exit Do

      'Calculate alpha, which is the deviation between A-direction to PC-direction

      Dim alpha1 As Double
      Dim alpha2 As Double
      alpha1 = (2 * Math.ATan(Math.Sqrt((2 * Math.Sqrt(k2 * ( -(k1 - k2))) + k1 - (2 * k2)) / k1)))
      alpha2 = (2 * Math.ATan(Math.Sqrt((-2 * Math.Sqrt(k2 * ( -(k1 - k2))) + k1 - (2 * k2)) / k1)))

      'apply aplpha to the PC-direction to get A-direction
      If (max) Then
        dir.Rotate(-alpha1, crv.Normal)
      Else
        dir.Rotate(-alpha2, crv.Normal)
      End If


      'optional additional angle!
      dir.Rotate(angle, crv.Normal)

      If (Not dir.IsValid) Then Exit Do
      If (Not dir.Unitize()) Then Exit Do

      'Scale the direction vector to match our accuracy.
      dir *= accuracy

      'Flip the direction 180 degrees if it seems to be going backwards
      Dim N As Integer = samples.Count
      If (N > 1) Then
        If (dir.IsParallelTo(samples(N - 1) - samples(N - 2), 0.5 * Math.PI) < 0) Then
          dir.Reverse()
        End If
      End If

      'Move the last point in the list along the curvature direction.
      Dim pt As Point3d = samples(samples.Count - 1) + dir

      Dim s, t As Double
      If (Not srf.ClosestPoint(pt, s, t)) Then Exit Do

      'Abort if we've wandered beyond the surface edge.
      If (Not U.IncludesParameter(s, True)) Then Exit Do
      If (Not V.IncludesParameter(t, True)) Then Exit Do

      'Abort if the new point is basically the same as the old point.
      If (Math.Abs(p.X - s) < 1e-12) AndAlso (Math.Abs(p.Y - t) < 1e-12) Then Exit Do

      p.X = s
      p.Y = t
    Loop

    Return samples
  End Function
# ---------- end vb ----------
pline = PolyLine(Vertices=vb.pts, Closed=False)  # -> simplify(Polyline)
panel_10 = Panel(vb.out)

reb = RebuildCurve(Curve=pline, Degree=Slider(3, range=0..10), Count=Slider(15, range=0..100), Tangents=False)

asymptotic_crv = Curve(reparameterize(flatten(reb)))
len = Length(Curve=asymptotic_crv)
panel_11 = Panel(len)
subtraction = Subtraction(A="6.49", B=len)
sqr = Square(Value=subtraction)
ma = MassAddition(Input=sqr)  # -> Result, PartialResults
num_2 = Number(ma.Result)
end = EndPoints(Curve=asymptotic_crv)  # -> Start, End
pt_6 = Point([end.End, end.Start])
pdecon = Deconstruct(Point=pt_6)  # -> XComponent, YComponent, ZComponent
smaller = SmallerThan(FirstNumber=pdecon.ZComponent, SecondNumber="0.1")  # -> SmallerThan, OrEqualTo
dispatch = Dispatch(List=pt_6, DispatchPattern=smaller.SmallerThan)  # -> ListA, ListB
pdecon_2 = Deconstruct(Point=dispatch.ListB)  # -> XComponent, YComponent, ZComponent
pt_7 = Point(dispatch.ListB)
alongcrv = SortAlongCurve(Points=pt_7, Curve=circle_3)  # -> Points, Indices
rtrig = RightTrigonometry(PLength=pdecon_2.ZComponent, RLength=number_slider_4)  # -> Alpha, Beta, PLength, QLength, RLength
item_4 = ListItem(List=rtrig.QLength, Index=0, Wrap=True)
duppt = RemoveDuplicatePts(Points=alongcrv.Points, Tolerance=0.01)
alongcrv_2 = SortAlongCurve(Points=duppt, Curve=circle_4)  # -> Points, Indices
shift = ShiftList(List=alongcrv_2.Points, Shift=1, Wrap=True)
graft = GraftTree(Tree=alongcrv_2.Points, IncludeEmptyLists=True, IncludeNullItems=True)  # -> simplify(Tree)
graft_2 = GraftTree(Tree=shift, IncludeEmptyLists=True, IncludeNullItems=True)  # -> simplify(Tree)
avr_2 = Average(Input=[graft, graft_2])
pull = PullPoint(Point=avr_2, Geometry=circle_4, ClosestOnly=True)  # -> ClosestPoint, Distance
pull_2 = PullPoint(Point=duppt, Geometry=circle_4, ClosestOnly=True)  # -> ClosestPoint, Distance
ln = Line(StartPoint=avr_2, EndPoint=pull.ClosestPoint)  # -> flatten(Line)
ln_2 = Line(StartPoint=duppt, EndPoint=pull_2.ClosestPoint)  # -> flatten(Line)
graft_3 = GraftTree(Tree=ln_2, IncludeEmptyLists=True, IncludeNullItems=True)
graft_4 = GraftTree(Tree=ln, IncludeEmptyLists=True, IncludeNullItems=True)
len_2 = Length(Curve=graft_3)
len_3 = Length(Curve=graft_4)
minsurf_2c_2 = MinimalSurface(C0Curve=graft_4, C1Curve=graft_3, UCount=20, VCount=20, Itteration=20, SurfaceUDegree=3, SurfaceVDegree=3)  # -> UVPointGrid, ResultingSurface
end_2 = EndPoints(Curve=graft_3)  # -> Start, End
multiplication_3 = Multiplication(A=len_2, B=Slider(1, range=1..1.05))
end_3 = EndPoints(Curve=graft_4)  # -> Start, End
multiplication_4 = Multiplication(A=len_3, B=Slider(1, range=1..1.05))
cat = Catenary(PointA=end_2.Start, PointB=end_2.End, Length=number_slider_5, Gravity=Vector(0, 0, -1))
cat_2 = Catenary(PointA=end_3.Start, PointB=end_3.End, Length=number_slider_5, Gravity=Vector(0, 0, -1))
minsurf_2c_3 = MinimalSurface(C0Curve=cat_2, C1Curve=cat, UCount=20, VCount=20, Itteration=20, SurfaceUDegree=3, SurfaceVDegree=3)  # -> UVPointGrid, ResultingSurface
loft = Loft(Curves=[cat_2, cat], Options={Adjust=False, Closed=False, LoftEnds=0, LoftSimp=0, LoftType=0, Rebuild=10, Refit=0.01})
edges = BrepEdges(Brep=loft)  # -> Naked, Interior, NonManifold
edges_2 = BrepEdges(Brep=loft)  # -> Naked, Interior, NonManifold
item_5 = ListItem(List=edges.Naked, Index=0, Wrap=True)
item_6 = ListItem(List=edges_2.Naked, Index=Slider(2, range=0..4), Wrap=True)
eval = EvaluateCurve(Curve=reparameterize(item_5), Parameter=Slider(1, range=0..1))  # -> Point, Tangent, Angle
eval_2 = EvaluateCurve(Curve=reparameterize(item_6), Parameter=Slider(1, range=0..1))  # -> Point, Tangent, Angle
ln_3 = Line(StartPoint=eval.Point, EndPoint=eval_2.Point)

# ----
# Geo for Structural Analysis
# Model for structural Analysis (def to be taken from thesis)
asymptoticscut = Curve(reparameterize(flatten(asymptotic_crv)))
mcx = MultipleCurves(Curves=flatten(asymptoticscut))  # -> Points, IndexA, IndexB, ParamA, ParamB
python = GhPythonScript(curvesInter=asymptoticscut, iA=mcx.IndexA, iB=mcx.IndexB, tA=mcx.ParamA, tB=mcx.ParamB, dl=Slider(0.4, range=0..1))  # -> lines, crv_segments; inputs curvesInter: list of Curve, iA: list of Int32, iB: list of Int32, tA: list, tB: list
# ---------- python: Python ----------
__author__ = "judyt"
__version__ = "2022.11.03"

import rhinoscriptsyntax as rs
import ghpythonlib.components as gh
from Grasshopper.Kernel.Data import GH_Path
from Grasshopper import DataTree
import scriptcontext as sc


def nestedListToDataTree(nestedlist):
    dataTree = DataTree[object]()
    for i, item_list in enumerate (nestedlist):
        path = GH_Path(i)
        dataTree.AddRange(item_list, path)
    return dataTree
    
    
numCrv = len(curvesInter)


#create empty dictionaries of parameters t and segments for each intersecting curve
dict_t = {}
for i in range(numCrv):
    dict_t[i] = []
    
#create a dictionary of parameters t

for i in range(len(iA)):
    for k in dict_t.keys():
        if iA[i] == k:
            if tA[i] != 0 and tA[i] != 1:
                dict_t[k].append(tA[i])
                
for i in range(len(iB)):
    for k in dict_t.keys():
        if iB[i] == k:
            if tB[i] != 0 and tB[i] != 1:
                dict_t[k].append(tB[i])
                
#split curvesInter into segments

s_list = []
for i in range(numCrv):
    segments = gh.Shatter(curvesInter[i], dict_t[i])
    print segments

 
    # if segments imported from Rhino:
    #segments = rs.SplitCurve(curvesInter[i], dict_t[i])
 
    s_list.append(segments)


# create tree of geodesic segments

print s_list
#create dicitonary of dicrete lines

lines = {}
for i in range (len(s_list)):
    lines[i] = []
    
for i in range (len(s_list)):
    for j in s_list[i]:
        num = rs.CurveLength(j)/dl
        if num<1:
            num ==1
        points = rs.DivideCurve(j, num)
        
        if points !=None:
            if len(points) == 2:
                line = rs.AddLine(rs.CurveStartPoint(j), rs.CurveEndPoint(j))
                lines[i].append(line)
            else:
                polyline = rs.AddPolyline(points)
                psegments = rs.ExplodeCurves(polyline)
                for p in psegments:
                    lines[i].append(p)
        else:
            line = rs.AddLine(rs.CurveStartPoint(j), rs.CurveEndPoint(j))
            lines[i].append(line)
            
#create tree of linear segments
l_list = []
for k in lines.keys():
    l_list.append(lines[k])
lin_segments = nestedListToDataTree(l_list)

_lines = nestedListToDataTree(l_list)
# create tree of geodesic segments

_crv_segments = nestedListToDataTree(s_list)
# ---------- end python ----------

crv_seg = Curve(python.crv_segments)
line = Line(python.lines)
end_4 = EndPoints(Curve=crv_seg)  # -> Start, End
duppt_2 = RemoveDuplicatePts(Points=flatten([end_4.Start, end_4.End]), Tolerance=0.01)
pdecon_3 = Deconstruct(Point=duppt_2)  # -> XComponent, YComponent, ZComponent
sort_3 = SortList(Keys=pdecon_3.ZComponent, ValuesA=duppt_2)  # -> Keys, ValuesA
series = Series(Start=0, Step=1, Count=multiplication)
item_7 = ListItem(List=sort_3.ValuesA, Index=series, Wrap=True)
fsim = FindSimilarMember(Data=item_7, Set=duppt_2)  # -> Hit, Index

end_5 = EndPoints(Curve=flatten(crv_seg))  # -> Start, End
len_4 = Length(Curve=asymptoticscut)
ma_2 = MassAddition(Input=len_4)  # -> Result, PartialResults
lenght_laths = Number(ma_2.Result)

lathwidth_cm = Slider(10, range=0..20)
support_pts = Point(flatten(fsim.Hit))
material_data_tree = Data(Tree({0;0}: [875], {0;1}: ["birch"], {0;2}: [75.8], {0;3}: [0.3], {0;4}: [1.4], {0;5}: [6.67], {0;6}: [3.995]))
node_pts = Point(flatten(duppt_2))
split_surface = Surface(minimalsurface_2)
line_2 = Line(line)

duppt_3 = RemoveDuplicatePts(Points=support_pts, Tolerance=0.01)

limit_distance = Number(Slider(0.005, range=0..0.01))
lathwidth_cm_2 = Number(lathwidth_cm)
crosssection = CrossSection(id="lath", height_cm=Slider(0.65, range=0..10), lathwidth_cm=lathwidth_cm_2)

crosec = CrossSectionKaramba3D(crosssection)

number_slider_9 = Slider(0, range=0..1)
ext = ExtendCurve(Curve=asymptotic_crv, Type="1", Start=number_slider_9, End=number_slider_9)
divide_3 = DivideCurve(Curve=ext, Count=Slider(100, range=0..100), Kinks=False)  # -> Points, Tangents, Parameters
panel_12 = Panel("{1;*}")
panel_13 = Panel("{0;*}")

divdist = DivideDistance(Curve=ext, Distance=Slider(0.05, range=0..0.1))  # -> Points, Tangents, Parameters

surface_closest_point = SurfaceClosestPoint(Point=divdist.Points, Surface=minimalsurface_2)  # -> Point, UVPoint, Distance
evaluate_surface = EvaluateSurface(Surface=minimalsurface_2, Point=surface_closest_point.UVPoint)  # -> Point, Normal, UDirection, VDirection, Frame
amplitude = Amplitude(Vector=evaluate_surface.Normal, Amplitude=Slider(0.05, range=0..0.1))

amplitude_2 = Amplitude(Vector=evaluate_surface.Normal, Amplitude=Slider(0.05, range=0..0.1))
rev = Reverse(Vector=amplitude_2)
rev_2 = Reverse(Vector=amplitude)
move = Move(Geometry=evaluate_surface.Point, Motion=amplitude_2)  # -> Geometry, Transform

move_2 = Move(Geometry=evaluate_surface.Point, Motion=rev_2)  # -> Geometry, Transform
ln_4 = Line(StartPoint=move_2.Geometry, EndPoint=move.Geometry)
loft_2 = Loft(Curves=ln_4, Options={Adjust=False, Closed=False, LoftEnds=0, LoftSimp=0, LoftType=0, Rebuild=10, Refit=0.01})
unrollpsrf = UnrollPolysurface(Polysurface=loft_2)  # -> Unrolled, UnrolledPoints, UnrolledCurves; disabled

analysis_lines_single_layer = Line(line_2)
# STRUCTURAL ANALYSIS
# _________________
membranemesh = Mesh(loft_2)
material_data_tree_2 = Data(material_data_tree)
srf = Surface(split_surface)
node_pt = Point(flatten(node_pts))
support_pt = Point(duppt_3)

lng = ListLength(List=node_pt)
no_joints = Number(lng)

_80kg = Panel("0.0537")
ll_factor = Slider(1.6, range=0..10)
d_factor = Slider(1.2, range=0..10)
intersection_point_front = Point(eval.Point)
node_pt_2 = Point(flatten(node_pt))

mesh_laths_for_wind = Mesh(membranemesh)

d_factor_2 = Slider(1.2, range=0..10)
_0_89kn = Panel("0.89")
push_vector = Curve(<curve referenced from the Rhino model>)
node_pt_3 = Point(flatten(node_pt))
pushpoint = Point(Point(-2.684421701, 3.875288926, 1.463277597))
srf_2 = Surface(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)

panel_14 = Panel(material_data_tree_2)

loadcase1 = LoadCase1(
    wind_pressure_kn_m2="0.6",
    mesh_laths_for_wind=mesh_laths_for_wind,
    w_factor=Slider(1, range=0..10),
    d_factor=Slider(0.9, range=0..1))
loadcase3 = LoadCase3(
    pushpoint=pushpoint,
    node_pt=node_pt_3,
    srf=srf_2,
    force_kn=_0_89kn,
    push_vector=push_vector,
    ll_factor=Slider(1.6, range=0..10),
    gravity_factor=d_factor_2)
loadcase2 = LoadCase2(
    force_kn_val=_80kg,
    force_kn_dir=ln_3,
    hangpoint=intersection_point_front,
    node_pt=node_pt_2,
    ll_factor=ll_factor,
    d_factor=d_factor)
loadcase0 = LoadCase0(factor=Slider(1.4, range=0..10))
lc3 = LoadKaramba3D(flatten(loadcase3))
lc0 = LoadKaramba3D(loadcase0)
lc1 = LoadKaramba3D(loadcase1)
lc2 = LoadKaramba3D(flatten(loadcase2))
filter = StreamFilter(Gate=list, Stream0=lc0, Stream1=lc1, Stream2=lc2, Stream3=lc3)
load = LoadKaramba3D(filter)

support_pt_2 = Point(support_pt)

fsim_2 = FindSimilarMember(Data=support_pt_2, Set=node_pt)  # -> Hit, Index
supp = SupportKaramba3D(PosInd=fsim_2.Hit, menu=[buttons(on, on, on, on, on, on)])

# ---- group: http://www.matweb.com/search/datasheet_print.aspx?matguid=53cc39384ece4da49785af1fcdb4e17f
karamba_material = KarambaMaterial(material_data_tree=material_data_tree_2)

# ----
karambabeams = KarambaBeams(id="lath", lines=analysis_lines_single_layer, ldist=limit_distance, srf=srf)
panel_15 = Panel(karamba_material)
element = ElementKaramba3D(flatten(karambabeams))
support = SupportKaramba3D(supp)
material = MaterialKaramba3D(karamba_material)
modifyelem = ModifyElementKaramba3D(Beam=element, Bending=True, mode="Beam")
assemble = AssembleModelKaramba3D(Elem=modifyelem, Support=support, Load=load, CrossSection=crosec, Material=material, LimitDistance_m=0.005)  # -> Model, Info, Mass_kg, CenterOfGravity, LoadCaseNames
panel_16 = Panel(assemble.Mass_kg)
analyzethii = AnalyzeThIIKaramba3D(Model=assemble.Model, LoadCase=list, RTolerance=1e-07, MaxIterations="100", NoTensionalNII=False)  # -> CalculatedModel, MaximumDisplacement_cm, ResultingForceOfGravity_kN, ElasticEnergy_kNm; disabled
analyzenonlin_wip = AnalyzeNonlinearWIPKaramba3D(
    Model=assemble.Model,
    NumberOfLoadSteps=1,
    NumberOfLoadIncrements=5,
    MaxNumberOfEquilibriumIterations=50,
    EquilibriumTolerance=1e-07,
    MaxNumberOfLimitLoadIterations=50,
    LimitLoadTolerance=0.01,
    mode="NewtonRaphson")  # -> CalculatedModel, MaximumDisplacement_cm, ElasticEnergy_kNm, Info, Lambdas; disabled
disassemble = DisassembleModelKaramba3D(Model=assemble.Model)  # -> Model, Point, Beam, Shell, Support, Load, Line, Mesh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; disabled
analyze = AnalyzeKaramba3D(Model=assemble.Model)  # -> CalculatedModel, MaximumDisplacement_cm, ResultingForceOfGravity_kN, ElasticEnergy_kNm
displacement = Number(analyze.MaximumDisplacement_cm)
energy = Number(analyze.ElasticEnergy_kNm)
merge_4 = Merge(Data1=flatten(energy), Data2=flatten(displacement), Data3=flatten(lenght_laths), Data4=flatten(no_joints))
panel_17 = Panel(merge_4)
panel_18 = Panel(analyze.ElasticEnergy_kNm)
panel_19 = Panel(analyzenonlin_wip.MaximumDisplacement_cm)
bmodes = BucklingModesKaramba3D(Model=analyzethii.CalculatedModel, FromIndex=1, NumberOfModes=1, MaximumNumberOfIterations=300, Epsilon=1e-07)  # -> ModelWithBucklingModesAsLoadCaseResults, BucklingLoadFactors
merge_5 = Merge(
    Data1=analyze.MaximumDisplacement_cm,
    Data2=analyzethii.MaximumDisplacement_cm,
    Data3=analyze.ElasticEnergy_kNm,
    Data4=bmodes.BucklingLoadFactors)
panel_20 = Panel(analyzethii.MaximumDisplacement_cm)
panel_21 = Panel(analyze.MaximumDisplacement_cm)
nodedisp = NodalDisplacementsKaramba3D(AnalyzedModel=analyze.CalculatedModel, LoadCase=0)  # -> AnalyzedModel, NodalTranslations_m, NodalRotations_rad
panel_22 = Panel(merge_5)
panel_23 = Panel(bmodes.BucklingLoadFactors)

modelview = ModelViewKaramba3D(Model=analyze.CalculatedModel, ResultFactors=1, ResultCase=-1, Colors=merge_3)  # -> Model, DeformedMesh, DeformedAxes, DeformedModel
beamview = BeamViewKaramba3D(Model=modelview.Model)  # -> Model, MeshesOfRenderedBeams, DeformedBeamAxes, LegendColors, LegendTags

legend = Legend(Colour=beamview.LegendColors, Tags=beamview.LegendTags, LegendType=101)

displacementmesh = Mesh(beamview.MeshesOfRenderedBeams)
nodal_translations = Vector(nodedisp.NodalTranslations_m)
modellin1 = ModelKaramba3D(analyze.CalculatedModel)
lineardisp = Number(analyze.MaximumDisplacement_cm)
nodept = Point(disassemble.Point)
bl_factor = Number(bmodes.BucklingLoadFactors)

mesh = Mesh(displacementmesh)

modellin1_2 = ModelKaramba3D(modellin1)
groups = Number()
inframe_geodesics_3 = Geometry([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])

groups_2 = Data(groups)
model = ModelKaramba3D(modellin1_2)

# ----
# Axial Stress
# Axial Stress combined with tortion
utilization = UtilizationOfElementsKaramba3D(
    AnalyzedModel=model,
    LoadCase=-1,
    NumberOfSamplePoints=3,
    ElasticDesign=True,
    GammaM0=1,
    GammaM1=1,
    WithDetails=False,
    mode="Beams")  # -> AnalyzedModel, Utilization, SigMax_kN_cm2, SigMin_kN_cm2, TauMax_kN_cm2, UtilN, UtilVy, UtilVz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
groups_3 = Data(groups)
larger = LargerThan(FirstNumber=utilization.UtilN, SecondNumber="1")  # -> LargerThan, OrEqualTo
indexes = Number(groups_3)
indexes_2 = Number(groups_3)
ma_3 = MassAddition(Input=larger.LargerThan)  # -> Result, PartialResults
item_8 = ListItem(List=utilization.SigMax_kN_cm2, Index=indexes, Wrap=True)
item_9 = ListItem(List=utilization.SigMin_kN_cm2, Index=indexes_2, Wrap=True)
sort_4 = SortList(Keys=item_8)  # -> Keys, ValuesA
sort_5 = SortList(Keys=item_9)  # -> Keys, ValuesA
item_10 = ListItem(List=sort_4.Keys, Index=0, Wrap=True)  # -> Item1, Item
item_11 = ListItem(List=sort_5.Keys, Index=0, Wrap=True)  # -> Item1, Item
multiplication_5 = Multiplication(A=item_11.Item, B="10")  # -> simplify(Result)
multiplication_6 = Multiplication(A=item_10.Item1, B="10")  # -> simplify(Result)
max_compression_tortion_stress_mpa = Number(multiplication_5)
max_tension_tortion_stress_mpa = Number(multiplication_6)
merge_6 = Merge(Data1=max_tension_tortion_stress_mpa, Data2=max_compression_tortion_stress_mpa)
abs = Absolute(Value=merge_6)
sort_6 = SortList(Keys=abs)  # -> Keys, ValuesA
item_12 = ListItem(List=sort_6.Keys, Index=0, Wrap=True)  # -> Item1, Item, Item1_2

# ----
# Axial Stress combuted from Axial Forces
b_forces = BeamForcesKaramba3D(AnalyzedModel=modellin1_2, LCase=-1, MaximumDistanceBetweenResults_m=-1, NumberOfResultsPerBeamElement=2)  # -> AnalyzedModel, NormalForce_kN, ShearForceVz_kN, ShearForceVy_kN, BendingMomentMt_kNm, BendingMomentMy_kNm, BendingMomentMz_kNm
panel_24 = Panel(b_forces.NormalForce_kN)
analysis_lines = Line()

# ---- group: axial forces lines
avr_3 = Average(Input=b_forces.NormalForce_kN)  # -> flatten(ArithmeticMean)
smaller_2 = SmallerThan(FirstNumber=avr_3, SecondNumber=0)  # -> SmallerThan, OrEqualTo
dispatch_2 = Dispatch(List=analysis_lines, DispatchPattern=smaller_2.SmallerThan)  # -> ListA, ListB
line_3 = Line(dispatch_2.ListA)
line_4 = Line(dispatch_2.ListB)
preview = CustomPreview(Geometry=line_4, Material=ColourSwatch(SwatchColor=RGB(0, 0, 255)))
preview_2 = CustomPreview(Geometry=line_3, Material=ColourSwatch(SwatchColor=RGB(255, 0, 0)))

# ---- group: axial forces geodesics
indexes_3 = Number(groups_2)
item_13 = ListItem(List=avr_3, Index=indexes_3, Wrap=True)
avr_4 = Average(Input=item_13)
smaller_3 = SmallerThan(FirstNumber=avr_4, SecondNumber="0")  # -> SmallerThan, OrEqualTo
dispatch_3 = Dispatch(List=inframe_geodesics_3, DispatchPattern=flatten(smaller_3.SmallerThan))  # -> ListA, ListB
crv_2 = Curve(dispatch_3.ListB)
crv_3 = Curve(dispatch_3.ListA)
preview_3 = CustomPreview(Geometry=crv_2, Material=ColourSwatch(SwatchColor=RGB(0, 0, 255)))
preview_4 = CustomPreview(Geometry=crv_3, Material=ColourSwatch(SwatchColor=RGB(255, 0, 0)))

# ----
bnd_2 = Bounds(Numbers=flatten(max_compression_tortion_stress_mpa))
bnd_3 = Bounds(Numbers=flatten(max_tension_tortion_stress_mpa))
panel_25 = Panel(bnd_3)
panel_26 = Panel(bnd_2)
max_abs_axial_stress_mpa = Number(item_12.Item1)
panel_27 = Panel(max_abs_axial_stress_mpa)

# ---- group: conservative approach - combined max ax and bedn over the whole element
max_absolute_tortion_stress_mpa = Number(flatten(max_abs_axial_stress_mpa))  # disabled
maxmimum_bending_stress_4 = Data(flatten(maxmimum_bending_stress_2))  # disabled

# ----
expression_5 = Expression(fbx=maxmimum_bending_stress_4, Expression="(fbx/51.12)")  # disabled
bnd_4 = Bounds(Numbers=expression_5)  # disabled

# ---- group: conservative approach - combined max ax and bedn over the whole element
# fcu - factoed (LRFD) compressive stress
# Fcn - adjusted LFRD compressive design value as given by the Ylinen formula
# fbx - actual working (ASD)bending stess
# Fbx - adjusted ASD bedning desing value
abs_2 = Absolute(Value=max_absolute_tortion_stress_mpa)  # disabled

# ----
expression_6 = Expression(fcu=abs_2, fbx=maxmimum_bending_stress_4, Expression="(fcu/39.4)²+(fbx/51.12)")  # disabled
expression_7 = Expression(fcu=abs_2, Expression="(fcu/39.4)² ")  # disabled
bnd_5 = Bounds(Numbers=expression_7)  # disabled

# ---- group: conservative approach - combined max ax and bedn over the whole element (continued)
panel_28 = Panel(expression_6)  # disabled

# ----
bnd_6 = Bounds(Numbers=panel_28)  # disabled
expression_8 = Expression(fcu=abs_2, fbx=maxmimum_bending_stress_4, Expression="(fcu/39.4)²+(fbx/51.12)≤1")  # disabled
panel_29 = Panel(bnd_6)  # disabled
bool = Boolean(invert(expression_8))  # disabled
ma_4 = MassAddition(Input=bool)  # -> Result, PartialResults; disabled
possible_broken_laths = Panel(ma_4.Result)  # disabled

# ==== cluster KarambaBeams
ldist = ClusterInput()
srf = ClusterInput()
lines = ClusterInput()
id = ClusterInput()
lines_2 = Line(flatten(lines))
srf_2 = Surface(reparameterize(srf))
# beams
id_2 = Data(id)
curvepoint = PointOnCurve(lines_2, parameter=0.5)
srf_cp = SurfaceClosestPoint(Point=curvepoint, Surface=srf_2)  # -> Point, UVPoint, Distance
evalsrf = EvaluateSurface(Surface=srf_2, Point=srf_cp.UVPoint)  # -> Point, Normal, UDirection, VDirection, Frame
nor_vect = Vector(evalsrf.UDirection)
linetobeam = LineToBeamKaramba3D(
    Line=lines_2,
    Identifier=id_2,
    New=True,
    Remove=True,
    LimitDistance_m=ldist,
    ZOrientation=nor_vect,
    Bending=Toggle(True),
    SetBucklingLength=True,
    ToPolylineMaxAngle=0.03,
    ToPolylineTolerance=0.01,
    ToPolylineMaxEdgeLength=0.25)  # -> Element, Points, Info
element = ElementKaramba3D(linetobeam.Element)
element_2 = ClusterOutput(element)

# ==== cluster LoadCase0
factor = ClusterInput()
factor_2 = Number(factor)

# ----
# loads - LC0
panel = Panel("-1.0")
Z = UnitZ(Factor=panel)

multiplication = Multiplication(A=Z, B=factor_2)

loads = LoadsKaramba3D(Vector=multiplication, LCase="0", mode="Gravity")

lc0 = LoadKaramba3D(loads)
lc0_2 = ClusterOutput(lc0)

# ==== cluster LoadCase1
wind_pressure_kn_m2 = ClusterInput()
mesh_laths_for_wind = ClusterInput()
d_factor = ClusterInput()
w_factor = ClusterInput()
wind_pressure_kn_m2_2 = Number(wind_pressure_kn_m2)
mesh_laths_for_wind_2 = Mesh(mesh_laths_for_wind)
w_factor_2 = Number(w_factor)
d_factor_2 = Number(d_factor)
X = UnitX(Factor=wind_pressure_kn_m2_2)
Z = UnitZ(Factor="-1.0")
multiplication = Multiplication(A=X, B=w_factor_2)
multiplication_2 = Multiplication(A=Z, B=d_factor_2)

# ----
# loads - LC1
loads = LoadsKaramba3D(
    Vector=multiplication,
    Mesh=mesh_laths_for_wind_2,
    LCase="1",
    mode="MeshLoad -Const.",
    menu=[buttons(off, off, on), buttons(on, on)])
loads_2 = LoadsKaramba3D(Vector=multiplication_2, LCase="1", mode="Gravity")

lc1 = LoadKaramba3D(flatten([loads_2, loads]))
lc1_2 = ClusterOutput(lc1)

# ==== cluster LoadCase2
node_pt = ClusterInput()
ll_factor = ClusterInput()
hangpoint = ClusterInput()
force_kn_dir = ClusterInput()
force_kn_val = ClusterInput()
d_factor = ClusterInput()
d_factor_2 = Number(d_factor)
node_pt_2 = Point(flatten(node_pt))
ll_factor_2 = Number(ll_factor)
hangpoint_2 = Point(hangpoint)
force_kn_dir_2 = Vector(force_kn_dir)
force_kn_val_2 = Number(force_kn_val)
unit = UnitVector(Vector=force_kn_dir_2)
multiplication = Multiplication(A=force_kn_val_2, B=ll_factor_2)
amp = Amplitude(Vector=unit, Amplitude=multiplication)
Z = UnitZ(Factor="-1.0")
multiplication_2 = Multiplication(A=force_kn_dir_2, B=ll_factor_2)
multiplication_3 = Multiplication(A=Z, B=d_factor_2)
fsim = FindSimilarMember(Data=hangpoint_2, Set=node_pt_2)  # -> Hit, Index

# ----
# loads - LC2
# hanging person
loads = LoadsKaramba3D(Vector=multiplication_3, LCase="2", mode="Gravity")
loads_2 = LoadsKaramba3D(ForceVector=amp, Local=False, PosInd=fsim.Hit, LCase="2", mode="Point")

lc2 = LoadKaramba3D(flatten([loads_2, loads]))
lc2_2 = ClusterOutput(lc2)

# ==== cluster LoadCase3
push_vector = ClusterInput()
force_kn = ClusterInput()
srf = ClusterInput()
pushpoint = ClusterInput()
pushpoint_2 = Point(pushpoint)
srf_2 = Surface(srf)
push_vector_2 = Curve(push_vector)
Z = UnitZ(Factor=1)
ll_factor = ClusterInput()
end = EndPoints(Curve=push_vector_2)  # -> Start, End
project = ProjectPoint(Point=pushpoint_2, Direction=Z, Geometry=srf_2)  # -> Point, Index
vec2pt = Vector2Pt(PointA=end.Start, PointB=end.End, Unitize=False)  # -> Vector, Length
gravity_factor = ClusterInput()
node_pt = ClusterInput()
vec = Vector(vec2pt.Vector)
node_pt_2 = Point(flatten(node_pt))
ll_factor_2 = Number(ll_factor)
vdis = VectorDisplay(Anchor=end.Start, Vector=vec)
gravity_factor_2 = Number(gravity_factor)
force_kn_2 = Number(force_kn)
cp = ClosestPoint(Point=project.Point, Cloud=node_pt_2)  # -> ClosestPoint, CPIndex, Distance
amp = Amplitude(Vector=vec, Amplitude=force_kn_2)
Z_2 = UnitZ(Factor="-1.0")
multiplication = Multiplication(A=amp, B=ll_factor_2)
multiplication_2 = Multiplication(A=Z_2, B=gravity_factor_2)

# ----
# loads - LC3 - pushing person
loads = LoadsKaramba3D(Vector=multiplication_2, LCase="3", mode="Gravity")
loads_2 = LoadsKaramba3D(ForceVector=multiplication, Local=False, PosInd=cp.ClosestPoint, LCase="3", mode="Point")

lc3 = LoadKaramba3D(flatten([loads_2, loads]))
lc3_2 = ClusterOutput(lc3)

# ==== cluster KarambaMaterial
material_data_tree = ClusterInput()
material_data_tree_2 = Data(material_data_tree)
matselect = MaterialSelectionKaramba3D(menu=[dropdown(4), dropdown(1)])

# ----
# material definition
bang = ExplodeTree(Data=material_data_tree_2)  # -> Branch0, Branch1, Branch2, Branch3, Branch4, Branch5, Branch6
shear_modulus_kn_cm2 = Number(bang.Branch2)
youngs_modulus_kn_cm2 = Number(bang.Branch0)
density_kn_m3 = Number(bang.Branch5)
poisson_ratio = Number(bang.Branch3)
radius_cm = Number(bang.Branch4)
fy_kn_cm2 = Number(bang.Branch6)
material_name = Text(bang.Branch1)

disassemble = DisassembleMaterialKaramba3D(Material=matselect)  # -> Material, TypeOfMaterial, FamilyNameOfMaterial, NameOfMaterial, ElemIdentifiers, Color, YoungsModulusKNCm2Dir12, InPlaneShearModulus_kN_cm2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
panel = Panel(material_name)
matprops = MaterialPropertiesKaramba3D(
    FamilyOfMaterial="wood",
    Name=panel,
    Color=disassemble.Color,
    YoungsModulus_kN_cm2="910",
    InPlaneShearModulus_kN_cm2=disassemble.InPlaneShearModulus_kN_cm2,
    TransverseShearModulus_kN_cm2=disassemble.TransverseShearModulusKNCm2Dir12,
    SpecificWeight_kN_m3="4.5",
    CoefficientOfThermalExpansion_1_C=disassemble.CoefficientOfThermalExpansion1CDir12,
    YieldStrength_kN_cm2=Slider(3.8, range=0..10),
    mode="Isotrop")
material = MaterialKaramba3D(matprops)
material_2 = ClusterOutput(material)

# ==== cluster CrossSection
lathwidth_cm = ClusterInput()
height_cm = ClusterInput()
id = ClusterInput()
id_2 = Data(id)
height_cm_2 = Number(height_cm)
lathwidth_cm_2 = Number(lathwidth_cm)
cross_section = CrossSectionKaramba3D(
    FamilyNameOfCrossSection="DefaultCroSec",
    ElementIdentifier=id_2,
    Material=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,
    Height_cm=height_cm_2,
    UpperFlangeWidth_cm=lathwidth_cm_2,
    LowerFlangeWidth_cm=lathwidth_cm_2,
    mode="Trapezoid")
crosec = CrossSectionKaramba3D(cross_section)
crosec_2 = ClusterOutput(crosec)
