# Grasshopper definition 230510_Asymptotic_Tower-master.gh (Grasshopper 1.0.7)
# plug-ins: GH_MinSurf, Karamba3D, Kangaroo2 Components, Pufferfish, Sturnella

r_bottom = Slider(1.2, range=0.2..1.5)
r_top = Slider(0.1, range=0.1..1.1)
asymptoticcount = Slider(8, range=2..30)

height = Slider(5.5, range=5..7)

# ----
# Main Geometry
pt = ConstructPoint(XCoordinate=0, YCoordinate=0, ZCoordinate=0)
pt_2 = ConstructPoint(XCoordinate=0, YCoordinate=0, ZCoordinate=height)
circle = CircleCNR(Center=pt, Normal=Vector(0, 0, 1), Radius=r_bottom)
circle_2 = CircleCNR(Center=pt_2, Normal=Vector(0, 0, 1), Radius=r_top)
minsurf_2c = MinimalSurface(C0Curve=circle, C1Curve=circle_2, UCount=20, VCount=20, Itteration=20, SurfaceUDegree=3, SurfaceVDegree=3)  # -> UVPointGrid, ResultingSurface

# ----
# Geo for Structural Analysis
# (Discretizitation of Asymptotics for FEM analysis)
license = LicenseKaramba3D()
panel = Panel(license)
multiplication = Multiplication(A=asymptoticcount, B="2")

shear_modulus_kn_cm2 = Panel("360")

# ----
# material data Okuame
_0_758gpa_shear_modulus_trough_thickness = Panel("75.8")
_0_207_gpa_shear_modulus_in_plane = Panel("20.7")
shear_modulus_kn_cm2_2 = Number(shear_modulus_kn_cm2)
youngs_modulus_kn_cm2 = Number("910")
density_kn_m3 = Number("4.5")
radius_cm = Number(Slider(1.4, range=0..10))
fy_kn_cm2 = Number("3.995")
poisson_ratio = Number("0.3")
material_name = Text("Okoume")
entwine = Entwine(
    Branch00=youngs_modulus_kn_cm2,
    Branch01=material_name,
    Branch02=shear_modulus_kn_cm2_2,
    Branch03=poisson_ratio,
    Branch04=radius_cm,
    Branch05=density_kn_m3,
    Branch06=fy_kn_cm2,
    FlattenInputs=True)

panel_2 = Panel("""60mph = 26.8224 m/s
=  470Pa =  0.47Kn/m2""")
# https://www.engineeringtoolbox.com/wind-load-d_1775.html
panel_3 = Panel("""50mph = 22.35m/s
=  290Pa =  0.29Kn/m2""")
material_data_tree = Data(Tree({0;0}: [875], {0;1}: ["birch"], {0;2}: [75.8], {0;3}: [0.3], {0;4}: [1.4], {0;5}: [6.67], {0;6}: [3.995]))
material_data_tree_2 = Data(Tree({0;0}: [875], {0;1}: ["birch"], {0;2}: [75.8], {0;3}: [0.3], {0;4}: [1.4], {0;5}: [6.67], {0;6}: [3.995]))

# ----
# material data tree
material_data_tree_3 = Data(entwine)

matselect = MaterialSelectionKaramba3D(menu=[dropdown(1), dropdown(2)])

run = BooleanToggle(True)
reset = Button()
python = PythonScript(Run=run, Reset=reset, Target=Slider(1000, range=1..1000), Interval=Slider(2000, range=0..10000))  # -> Iter, Counter; inputs Run: Boolean
# ---------- python: Python ----------
import Grasshopper as gh

def updateComponent(interval):
    
    """ Update this component similar to using a grasshopper timer """
    
    def callBack(e):
        ghenv.Component.ExpireSolution(False)
        
    ghenv.Component.OnPingDocument().ScheduleSolution(interval,
    gh.Kernel.GH_Document.GH_ScheduleDelegate(callBack))

# Instantiate or reset persistent counter variable
if "count" not in globals() or Reset:
    count = 0

# Update the variable and component
if Run and not Reset and count < Target:
    count +=1
    updateComponent(Interval)

# Output counter
Counter = count%2
Iter = count
# ---------- end python ----------
panel_4 = Panel(python.Iter)
panel_5 = Panel(python.Counter)
number_slider = Slider(1200, range=0..10000)
concat = Concatenate(FragmentA="opti", FragmentB=panel_4)
captureview = LBCaptureView(
    file_name=concat,
    folder="C:\Users\judyt\Dropbox\EVENTS\23005_BurningMan\230510\run4",
    viewport="Perspective_3",
    width=number_slider,
    height=number_slider,
    capture=python.Counter)  # -> file; plug-in component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

# ----
# GEOMETRY
# ___________________________________________________________________________________________________________
# 3D Fabric Geo
minimalsurface = Surface(minsurf_2c.ResultingSurface)
lath_width_m = Slider(0.1, range=0..1)
merge = Merge(Data1=r_bottom, Data2=r_top, Data3=height, Data4=asymptoticcount)
panel_6 = Panel(merge)
panel_7 = Panel("""R Bottom
R Top
Num Asymptotics""")
minimalsurface_2 = Surface(minimalsurface)
division = Division(A=lath_width_m, B="2")

# ----
# Asymptotics
debrep = DeconstructBrep(Brep=minimalsurface)  # -> Faces, Edges, Vertices
item = ListItem(List=debrep.Edges, Index=0, Wrap=True)  # -> Item, Item1
divide = DivideCurve(Curve=item.Item1, Count=asymptoticcount, Kinks=False)  # -> Points, Tangents, Parameters
pt_3 = Point(divide.Points)
srf_cp = SurfaceCP(Point=pt_3, Surface=minimalsurface)  # -> Point, UVPoint, Distance

# ----
# Asymptotic Lines
# faster (no data output)
angle = Slider(0, range=-90..90)
panel_8 = Panel("""True
False""")
rad = Radians(Degrees=angle)
vb = VBScript(srf=minimalsurface, uv=srf_cp.UVPoint, accuracy=Slider(0.005, range=0..0.01), angle=rad, max=graft(panel_8))  # -> out, pts; inputs srf: Surface, uv: Point3d
# ---------- vb: VB usings ----------
Imports System.IO
Imports System.Linq
Imports System.Data
Imports System.Drawing
Imports System.Reflection
Imports System.Windows.Forms
Imports System.Xml
Imports System.Xml.Linq
Imports Microsoft.VisualBasic
Imports System.Runtime.InteropServices

Imports Rhino.DocObjects
Imports Rhino.Collections
Imports GH_IO
Imports GH_IO.Serialization
# ---------- vb: VB ----------
    If (srf Is Nothing) Then Return
    If (Not uv.IsValid) Then Return

    'Limit the accuracy to the document tolerance.
    accuracy = Math.Max(accuracy, doc.ModelAbsoluteTolerance)

    'Declare our list of samples.
    Dim dir0 As List(Of Point3d) = SampleCurvature(srf, uv, accuracy, max, angle)
    Dim dir1 As List(Of Point3d) = SampleCurvature(srf, uv, accuracy, max, angle + Math.PI)

    'Remove the first point in dir1 as it's a duplicate
    dir1.RemoveAt(0)
    dir1.Reverse()

    dir1.AddRange(dir0)
    pts = dir1
# ---------- vb: VB additional code ----------
  Private Function SampleCurvature(ByVal srf As Surface, ByVal uv As Point3d, ByVal accuracy As Double, ByVal max As Boolean, ByVal angle As Double) As List(Of Point3d)
    Dim p As Point3d = uv
    Dim U As Interval = srf.Domain(0)
    Dim V As Interval = srf.Domain(1)

    Dim samples As New List(Of Point3d)
    Do
      'Abort if we've added more than 10,000 samples
      If (samples.Count > 10000) Then Exit Do

      'Get the curvature at the current point
      Dim crv As SurfaceCurvature = srf.CurvatureAt(p.X, p.Y)
      If (crv Is Nothing) Then Exit Do

      'Add the current point
      samples.Add(srf.PointAt(p.X, p.Y))

      'Get the maximum principal direction & values
      Dim dir As Vector3d
      Dim k1 = 0
      Dim k2 = 0
      If (crv.Kappa(0) > crv.Kappa(1)) Then
        If (max) Then
          dir = crv.Direction(0)
          k1 = crv.Kappa(0)
          k2 = crv.Kappa(1)
        Else
          dir = crv.Direction(1)
          k1 = crv.Kappa(1)
          k2 = crv.Kappa(0)
        End If
      Else
        If (max) Then
          dir = crv.Direction(1)
          k1 = crv.Kappa(1)
          k2 = crv.Kappa(0)
        Else
          dir = crv.Direction(0)
          k1 = crv.Kappa(0)
          k2 = crv.Kappa(1)
        End If
      End If


      'check if you are on an anticlastic surface, if not: Exit
      If (k1 * k2 > 0) Then Exit Do

      'Calculate alpha, which is the deviation between A-direction to PC-direction

      Dim alpha1 As Double
      Dim alpha2 As Double
      alpha1 = (2 * Math.ATan(Math.Sqrt((2 * Math.Sqrt(k2 * ( -(k1 - k2))) + k1 - (2 * k2)) / k1)))
      alpha2 = (2 * Math.ATan(Math.Sqrt((-2 * Math.Sqrt(k2 * ( -(k1 - k2))) + k1 - (2 * k2)) / k1)))

      'apply aplpha to the PC-direction to get A-direction
      If (max) Then
        dir.Rotate(-alpha1, crv.Normal)
      Else
        dir.Rotate(-alpha2, crv.Normal)
      End If


      'optional additional angle!
      dir.Rotate(angle, crv.Normal)

      If (Not dir.IsValid) Then Exit Do
      If (Not dir.Unitize()) Then Exit Do

      'Scale the direction vector to match our accuracy.
      dir *= accuracy

      'Flip the direction 180 degrees if it seems to be going backwards
      Dim N As Integer = samples.Count
      If (N > 1) Then
        If (dir.IsParallelTo(samples(N - 1) - samples(N - 2), 0.5 * Math.PI) < 0) Then
          dir.Reverse()
        End If
      End If

      'Move the last point in the list along the curvature direction.
      Dim pt As Point3d = samples(samples.Count - 1) + dir

      Dim s, t As Double
      If (Not srf.ClosestPoint(pt, s, t)) Then Exit Do

      'Abort if we've wandered beyond the surface edge.
      If (Not U.IncludesParameter(s, True)) Then Exit Do
      If (Not V.IncludesParameter(t, True)) Then Exit Do

      'Abort if the new point is basically the same as the old point.
      If (Math.Abs(p.X - s) < 1e-12) AndAlso (Math.Abs(p.Y - t) < 1e-12) Then Exit Do

      p.X = s
      p.Y = t
    Loop

    Return samples
  End Function
# ---------- end vb ----------
pline = PolyLine(Vertices=vb.pts, Closed=False)  # -> simplify(Polyline)
panel_9 = Panel(vb.out)

reb = RebuildCurve(Curve=pline, Degree=Slider(3, range=0..10), Count=Slider(15, range=0..100), Tangents=False)

asymptotic_crv = Curve(reparameterize(flatten(reb)))

end = EndPoints(Curve=asymptotic_crv)  # -> Start, End
pt_4 = Point([end.End, end.Start])
pdecon = Deconstruct(Point=pt_4)  # -> XComponent, YComponent, ZComponent
smaller = SmallerThan(FirstNumber=pdecon.ZComponent, SecondNumber="0.1")  # -> SmallerThan, OrEqualTo
dispatch = Dispatch(List=pt_4, DispatchPattern=smaller.SmallerThan)  # -> ListA, ListB
pdecon_2 = Deconstruct(Point=dispatch.ListB)  # -> XComponent, YComponent, ZComponent
rtrig = RightTrigonometry(PLength=pdecon_2.ZComponent, RLength=Slider(7.9, range=0..10))  # -> Alpha, Beta, PLength, QLength, RLength
pt_5 = ConstructPoint(XCoordinate=0, YCoordinate=0, ZCoordinate=0)
item_2 = ListItem(List=rtrig.QLength, Index=0, Wrap=True)
circle_3 = CircleCNR(Center=pt_5, Normal=Vector(0, 0, 1), Radius=item_2)
circle_bottom = Curve(circle_3)
circle_top = Curve(circle_2)
divide_2 = DivideCurve(Curve=circle_bottom, Count=Slider(24, range=0..100), Kinks=False)  # -> Points, Tangents, Parameters
divide_3 = DivideCurve(Curve=circle_top, Count=Slider(24, range=0..100), Kinks=False)  # -> Points, Tangents, Parameters
ln = Line(StartPoint=divide_2.Points, EndPoint=divide_3.Points)
shift = ShiftList(List=ln, Shift=1, Wrap=True)
graft = GraftTree(Tree=simplify(shift), IncludeEmptyLists=True, IncludeNullItems=True)  # -> simplify(Tree)
graft_2 = GraftTree(Tree=simplify(ln), IncludeEmptyLists=True, IncludeNullItems=True)  # -> simplify(Tree)
merge_2 = Merge(Data1=graft_2, Data2=graft)
item_3 = ListItem(List=merge_2, Index=0, Wrap=True)  # -> Item, Item1
loft = Loft(Curves=merge_2, Options={Adjust=False, Closed=False, LoftEnds=0, LoftSimp=0, LoftType=0, Rebuild=10, Refit=0.01})
minsurf_2c_2 = MinimalSurface(C0Curve=item_3.Item, C1Curve=item_3.Item1, UCount=20, VCount=20, Itteration=20, SurfaceUDegree=3, SurfaceVDegree=3)  # -> UVPointGrid, ResultingSurface
dispatch_2 = Dispatch(List=flatten(loft), DispatchPattern=[True, False])  # -> ListA, ListB

asymptoticscut = Curve(reparameterize(flatten(asymptotic_crv)))
number_slider_2 = Slider(0.4, range=0..1)
mcx = MultipleCurves(Curves=flatten(asymptoticscut))  # -> Points, IndexA, IndexB, ParamA, ParamB
python_2 = GhPythonScript(curvesInter=asymptoticscut, iA=mcx.IndexA, iB=mcx.IndexB, tA=mcx.ParamA, tB=mcx.ParamB, dl=number_slider_2)  # -> lines, crv_segments; inputs curvesInter: list of Curve, iA: list of Int32, iB: list of Int32, tA: list, tB: list
# ---------- python_2: Python ----------
__author__ = "judyt"
__version__ = "2022.11.03"

import rhinoscriptsyntax as rs
import ghpythonlib.components as gh
from Grasshopper.Kernel.Data import GH_Path
from Grasshopper import DataTree
import scriptcontext as sc


def nestedListToDataTree(nestedlist):
    dataTree = DataTree[object]()
    for i, item_list in enumerate (nestedlist):
        path = GH_Path(i)
        dataTree.AddRange(item_list, path)
    return dataTree
    
    
numCrv = len(curvesInter)


#create empty dictionaries of parameters t and segments for each intersecting curve
dict_t = {}
for i in range(numCrv):
    dict_t[i] = []
    
#create a dictionary of parameters t

for i in range(len(iA)):
    for k in dict_t.keys():
        if iA[i] == k:
            if tA[i] != 0 and tA[i] != 1:
                dict_t[k].append(tA[i])
                
for i in range(len(iB)):
    for k in dict_t.keys():
        if iB[i] == k:
            if tB[i] != 0 and tB[i] != 1:
                dict_t[k].append(tB[i])
                
#split curvesInter into segments

s_list = []
for i in range(numCrv):
    segments = gh.Shatter(curvesInter[i], dict_t[i])
    print segments

 
    # if segments imported from Rhino:
    #segments = rs.SplitCurve(curvesInter[i], dict_t[i])
 
    s_list.append(segments)


# create tree of geodesic segments

print s_list
#create dicitonary of dicrete lines

lines = {}
for i in range (len(s_list)):
    lines[i] = []
    
for i in range (len(s_list)):
    for j in s_list[i]:
        num = rs.CurveLength(j)/dl
        if num<1:
            num ==1
        points = rs.DivideCurve(j, num)
        
        if points !=None:
            if len(points) == 2:
                line = rs.AddLine(rs.CurveStartPoint(j), rs.CurveEndPoint(j))
                lines[i].append(line)
            else:
                polyline = rs.AddPolyline(points)
                psegments = rs.ExplodeCurves(polyline)
                for p in psegments:
                    lines[i].append(p)
        else:
            line = rs.AddLine(rs.CurveStartPoint(j), rs.CurveEndPoint(j))
            lines[i].append(line)
            
#create tree of linear segments
l_list = []
for k in lines.keys():
    l_list.append(lines[k])
lin_segments = nestedListToDataTree(l_list)

_lines = nestedListToDataTree(l_list)
# create tree of geodesic segments

_crv_segments = nestedListToDataTree(s_list)
# ---------- end python_2 ----------

crv_seg = Curve(python_2.crv_segments)
line = Line(python_2.lines)
end_2 = EndPoints(Curve=crv_seg)  # -> Start, End
duppt = RemoveDuplicatePts(Points=flatten([end_2.Start, end_2.End]), Tolerance=0.01)
pdecon_3 = Deconstruct(Point=duppt)  # -> XComponent, YComponent, ZComponent
sort = SortList(Keys=pdecon_3.ZComponent, ValuesA=duppt)  # -> Keys, ValuesA
series = Series(Start=0, Step=1, Count=multiplication)
item_4 = ListItem(List=sort.ValuesA, Index=series, Wrap=True)
fsim = FindSimilarMember(Data=item_4, Set=duppt)  # -> Hit, Index

# ----
# 3D  Laths Geo
number_slider_3 = Slider(0, range=0..1)
ext = ExtendCurve(Curve=asymptotic_crv, Type="1", Start=number_slider_3, End=number_slider_3)

divdist = DivideDistance(Curve=ext, Distance=Slider(0.05, range=0..0.1))  # -> Points, Tangents, Parameters

surface_closest_point = SurfaceClosestPoint(Point=divdist.Points, Surface=minimalsurface_2)  # -> Point, UVPoint, Distance
evaluate_surface = EvaluateSurface(Surface=minimalsurface_2, Point=surface_closest_point.UVPoint)  # -> Point, Normal, UDirection, VDirection, Frame
amplitude = Amplitude(Vector=evaluate_surface.Normal, Amplitude=division)

amplitude_2 = Amplitude(Vector=evaluate_surface.Normal, Amplitude=division)
rev = Reverse(Vector=amplitude_2)
move = Move(Geometry=evaluate_surface.Point, Motion=amplitude_2)  # -> Geometry, Transform

rev_2 = Reverse(Vector=amplitude)

move_2 = Move(Geometry=evaluate_surface.Point, Motion=rev_2)  # -> Geometry, Transform
ln_2 = Line(StartPoint=move_2.Geometry, EndPoint=move.Geometry)
loft_2 = Loft(Curves=ln_2, Options={Adjust=False, Closed=False, LoftEnds=0, LoftSimp=0, LoftType=0, Rebuild=10, Refit=0.01})

lath_srf = Surface(loft_2)
_12_patels_surf_straight = Surface(dispatch_2.ListA)

# ---- group: unroll lath surface
unrollpsrf = UnrollPolysurface(Polysurface=lath_srf)  # -> Unrolled, UnrolledPoints, UnrolledCurves; disabled

# ----
edges = BrepEdges(Brep=_12_patels_surf_straight)  # -> Naked, Interior, NonManifold
item_5 = ListItem(List=edges.Naked, Index=Slider(2, range=0..10), Wrap=True)
item_6 = ListItem(List=edges.Naked, Index=0, Wrap=True)
curvepoint = PointOnCurve(item_5, parameter=0.5)
curvepoint_2 = PointOnCurve(item_6, parameter=0.5)
vec2pt = Vector2Pt(PointA=curvepoint, PointB=curvepoint_2, Unitize=False)  # -> Vector, Length
vdis = VectorDisplay(Anchor=curvepoint, Vector=vec2pt.Vector)

# ----
# GEO PREPARATIONS FOR FEM
# __________________________________
number_slider_4 = Slider(0.1, range=0..0.1)
mesh_breps = MeshBrepsKaramba3D(
    Brep=lath_srf,
    MeshResolution=number_slider_4,
    EdgeRefinementFactor=0.67,
    PointReduction=False,
    SmoothingStepSize=0,
    SmoothingIterations=5)  # -> Mesh, Info

mesh_breps_2 = MeshBrepsKaramba3D(
    Brep=_12_patels_surf_straight,
    MeshResolution=Slider(0.1, range=0..0.1),
    EdgeRefinementFactor=0.67,
    PointReduction=False,
    SmoothingStepSize=0,
    SmoothingIterations=5)  # -> Mesh, Info

lathwidth_cm = Slider(10, range=0..20)
hang_points_patels = Point(curvepoint)
force_dir_patels = Vector(vec2pt.Vector)
mesh_patels = Mesh(mesh_breps_2.Mesh)
material_data_tree_4 = Data(Tree({0;0}: [875], {0;1}: ["birch"], {0;2}: [75.8], {0;3}: [0.3], {0;4}: [1.4], {0;5}: [6.67], {0;6}: [3.995]))
support_pts = Point(flatten(fsim.Hit))
linear_asymptotic_segments = Line(line)
node_pts = Point(flatten(duppt))
mesh_laths = Mesh(mesh_breps.Mesh)
tower_surface = Surface(minimalsurface_2)

duppt_2 = RemoveDuplicatePts(Points=support_pts, Tolerance=0.01)
panel_10 = Panel(material_data_tree_4)

panel_11 = Panel("""70mph = 31n/s
=  577Pa =  0.577 Kn/m2""")
mesh_laths_for_wind = Mesh(mesh_patels)
w_factor = Slider(1, range=0..10)
d_factor = Slider(0.9, range=0..1)
panel_12 = Panel("0.6")

mesh_patels_2 = Mesh(mesh_patels)
mesh_laths_2 = Mesh(mesh_laths)
weld = WeldMesh(Mesh=flatten(mesh_laths_2), Angle=3.141592654)
hang_points_patels_2 = Point(flatten(hang_points_patels))

analysis_lines_single_layer = Line(linear_asymptotic_segments)
material_data_tree_5 = Data(material_data_tree_3)
srf = Surface(tower_surface)
node_pt = Point(flatten(node_pts))
support_pt = Point(duppt_2)

# ----
# knit fabric is 2mm thick with weight of 0.076g/cm^2
# 
# 7.2mx1m = 7.2m2 = 7.2 x100x100cm2 = 72000cm2
# 
# 72000cm2 x 0.076g = 5,472g = 5.472kg = 0.0537 kN
panel_13 = Panel("""90mph = 40m/s
=  960Pa =  0.96 Kn/m2""")
one_patel_weight_5_5kg = Panel("0.0537")
w_factor_2 = Slider(1, range=0..10)
d_factor_2 = Slider(1.2, range=0..10)
ll_factor = Slider(1.2, range=0..10)
node_pt_2 = Point(flatten(node_pt))

# ----
# knit fabric is 2mm thick with weight of 0.076g/cm^2
# 
# 7.2mx1m = 7.2m2 = 7.2 x100x100cm2 = 72000cm2
# 
# 72000cm2 x 0.076g = 5,472g = 5.472kg = 0.0537 kN
panel_14 = Panel("""90mph = 40m/s
=  960Pa =  0.96 Kn/m2""")
one_patel_weight_5_5kg_2 = Panel("0.0537")
w_factor_3 = Slider(1, range=0..10)
d_factor_3 = Slider(1.2, range=0..10)
ll_factor_2 = Slider(1.2, range=0..10)
node_pt_3 = Point(flatten(node_pt))

# ----
# knit fabric is 2mm thick with weight of 0.076g/cm^2
# 
# 7.2mx1m = 7.2m2 = 7.2 x100x100cm2 = 72000cm2
# 
# 72000cm2 x 0.076g = 5,472g = 5.472kg = 0.0537 kN
one_patel_weight_5_5kg_3 = Panel("0.0537")
ll_factor_3 = Slider(1.6, range=0..10)
d_factor_4 = Slider(1.2, range=0..10)
node_pt_4 = Point(flatten(node_pt))

force_dir_patels_2 = Vector(flatten(force_dir_patels))

limit_distance = Number(Slider(0.005, range=0..0.01))
lathwidth_cm_2 = Number(lathwidth_cm)
number_slider_5 = Slider(1.2, range=0..10)
crosssection = CrossSection(id="lath", height_cm=number_slider_5, lathwidth_cm=lathwidth_cm_2)

loadcase3 = LoadCase2(
    force_kn_val=one_patel_weight_5_5kg,
    force_kn_dir=force_dir_patels_2,
    hangpoint=hang_points_patels_2,
    node_pt=node_pt_2,
    ll_factor=ll_factor,
    d_factor=d_factor_2,
    wind_pressure_kn_m2="0.96",
    meshfor_wind=weld,
    w_factor=w_factor_2)
item_7 = ListItem(List=flatten(material_data_tree_5), Index=0, Wrap=True)  # -> Item, Item1
lc4 = LoadKaramba3D(flatten(loadcase3))

# ---- group: http://www.matweb.com/search/datasheet_print.aspx?matguid=53cc39384ece4da49785af1fcdb4e17f
karamba_material = KarambaMaterial(material_data_tree=material_data_tree_5)

# ----
edges_2 = BrepEdges(Brep=_12_patels_surf_straight)  # -> Naked, Interior, NonManifold

# ----
# STRUCTURAL ANALYSIS
# _________________
mesh_patels_3 = Mesh(mesh_patels)
mesh_laths_3 = Mesh(mesh_laths)
panel_15 = Panel("0.96")
weld_2 = WeldMesh(Mesh=flatten([mesh_patels_3, mesh_laths_3]), Angle=3.141592654)
hang_points_patels_3 = Point(flatten(hang_points_patels))
hang_points_patels_4 = Point(flatten(hang_points_patels))
force_dir_patels_3 = Vector(flatten(force_dir_patels))
force_dir_patels_4 = Vector(flatten(force_dir_patels))
panel_16 = Panel(material_data_tree_5)
support_pt_2 = Point(support_pt)
karambabeams = KarambaBeams(id="lath", lines=analysis_lines_single_layer, ldist=limit_distance, srf=srf)
panel_17 = Panel(karamba_material)
list = ValueList({"LoadCase0 (1.4D)": 0, "LoadCase1 (0.9D+ 1.0W)": 1, "LoadCase2 (1.2D + 1.6LL)": 2, "LoadCase3(1.2D + 1.2LL+ 1.0W)": 3, "LoadCase4(1.2D + 1.2LL+ 1.0W*)": 4}, selected="LoadCase4(1.2D + 1.2LL+ 1.0W*)")
element = ElementKaramba3D(flatten(karambabeams))
crosec = CrossSectionKaramba3D(crosssection)
material = MaterialKaramba3D(karamba_material)
modifyelem = ModifyElementKaramba3D(Beam=element, Bending=True, mode="Beam")
swatch = ColourSwatch(SwatchColor=RGB(0, 0, 255))
merge_3 = Merge(
    Data1=swatch,
    Data2=swatch,
    Data3=swatch,
    Data4=swatch,
    Data5=swatch,
    Data6=swatch,
    Data7=swatch,
    Data8=ColourSwatch(SwatchColor=RGB(0, 0, 255)),
    Data9=ColourSwatch(SwatchColor=RGB(0, 0, 255)),
    Data10=ColourSwatch(SwatchColor=RGB(0, 178, 255)),
    Data11=ColourSwatch(SwatchColor=RGB(0, 255, 255)),
    Data12=ColourSwatch(SwatchColor=RGB(0, 255, 179)),
    Data13=ColourSwatch(SwatchColor=RGB(0, 255, 0)),
    Data14=ColourSwatch(SwatchColor=RGB(178, 255, 0)),
    Data15=ColourSwatch(SwatchColor=RGB(255, 255, 0)),
    Data16=ColourSwatch(SwatchColor=RGB(255, 178, 0)),
    Data17=ColourSwatch(SwatchColor=RGB(255, 0, 0)))

loadcase1 = LoadCase1(wind_pressure_kn_m2="0.96", mesh_laths_for_wind=mesh_laths_for_wind, w_factor=w_factor, d_factor=d_factor)
loadcase2 = LoadCase2(
    force_kn_val=one_patel_weight_5_5kg_3,
    force_kn_dir=force_dir_patels_3,
    hangpoint=hang_points_patels_3,
    node_pt=node_pt_4,
    ll_factor=ll_factor_3,
    d_factor=d_factor_4)
loadcase3_2 = LoadCase2(
    force_kn_val=one_patel_weight_5_5kg_2,
    force_kn_dir=force_dir_patels_4,
    hangpoint=hang_points_patels_4,
    node_pt=node_pt_3,
    ll_factor=ll_factor_2,
    d_factor=d_factor_3,
    wind_pressure_kn_m2="0.29",
    meshfor_wind=weld_2,
    w_factor=w_factor_3)
loadcase0 = LoadCase0(factor=Slider(1.4, range=0..10))
lc3 = LoadKaramba3D(flatten(loadcase3_2))
lc0 = LoadKaramba3D(loadcase0)
lc1 = LoadKaramba3D(loadcase1)
lc2 = LoadKaramba3D(flatten(loadcase2))
filter = StreamFilter(Gate=list, Stream0=lc0, Stream1=lc1, Stream2=lc2, Stream3=lc3, Stream4=lc4)
load = LoadKaramba3D(filter)

fsim_2 = FindSimilarMember(Data=support_pt_2, Set=node_pt)  # -> Hit, Index
supp = SupportKaramba3D(PosInd=fsim_2.Hit, menu=[buttons(on, on, on, on, on, on)])

support = SupportKaramba3D(supp)
assemble = AssembleModelKaramba3D(Elem=modifyelem, Support=support, Load=load, CrossSection=crosec, Material=material, LimitDistance_m=0.005)  # -> Model, Info, Mass_kg, CenterOfGravity, LoadCaseNames
panel_18 = Panel(assemble.Mass_kg)
analyzethii = AnalyzeThIIKaramba3D(Model=assemble.Model, LoadCase=list, RTolerance=1e-07, MaxIterations="100", NoTensionalNII=False)  # -> CalculatedModel, MaximumDisplacement_cm, ResultingForceOfGravity_kN, ElasticEnergy_kNm; disabled
disassemble = DisassembleModelKaramba3D(Model=assemble.Model)  # -> Model, Point, Beam, Shell, Support, Load, Line, Mesh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; disabled
analyzenonlin_wip = AnalyzeNonlinearWIPKaramba3D(
    Model=assemble.Model,
    NumberOfLoadSteps=1,
    NumberOfLoadIncrements=5,
    MaxNumberOfEquilibriumIterations=50,
    EquilibriumTolerance=1e-07,
    MaxNumberOfLimitLoadIterations=50,
    LimitLoadTolerance=0.01,
    mode="NewtonRaphson")  # -> CalculatedModel, MaximumDisplacement_cm, ElasticEnergy_kNm, Info, Lambdas
analyze = AnalyzeKaramba3D(Model=assemble.Model)  # -> CalculatedModel, MaximumDisplacement_cm, ResultingForceOfGravity_kN, ElasticEnergy_kNm
bmodes = BucklingModesKaramba3D(Model=analyzethii.CalculatedModel, FromIndex=1, NumberOfModes=1, MaximumNumberOfIterations=300, Epsilon=1e-07)  # -> ModelWithBucklingModesAsLoadCaseResults, BucklingLoadFactors
panel_19 = Panel(analyzethii.MaximumDisplacement_cm)
panel_20 = Panel(analyzenonlin_wip.MaximumDisplacement_cm)
panel_21 = Panel(analyze.MaximumDisplacement_cm)
nodedisp = NodalDisplacementsKaramba3D(AnalyzedModel=analyze.CalculatedModel, LoadCase=0)  # -> AnalyzedModel, NodalTranslations_m, NodalRotations_rad
panel_22 = Panel(bmodes.BucklingLoadFactors)

merge_4 = Merge(Data1=panel_21, Data2=panel_20)
panel_23 = Panel(merge_4)

modelview = ModelViewKaramba3D(Model=analyze.CalculatedModel, ResultFactors=1, ResultCase=-1, Colors=merge_3)  # -> Model, DeformedMesh, DeformedAxes, DeformedModel
beamview = BeamViewKaramba3D(Model=modelview.Model)  # -> Model, MeshesOfRenderedBeams, DeformedBeamAxes, LegendColors, LegendTags

displacementmesh = Mesh(beamview.MeshesOfRenderedBeams)
nodal_translations = Vector(nodedisp.NodalTranslations_m)
modellin1 = ModelKaramba3D(analyze.CalculatedModel)
lineardisp = Number(analyze.MaximumDisplacement_cm)
nodept = Point(disassemble.Point)
bl_factor = Number(bmodes.BucklingLoadFactors)

legend = Legend(Colour=beamview.LegendColors, Tags=beamview.LegendTags, LegendType=101)
mesh = Mesh(displacementmesh)

len = Length(Curve=asymptoticscut)
lng = ListLength(List=node_pt)
ma = MassAddition(Input=len)  # -> Result, PartialResults
displacement_i = Number(analyze.MaximumDisplacement_cm)
lenght_laths = Number(ma.Result)
no_joints = Number(lng)
energy_i = Number(analyze.ElasticEnergy_kNm)
merge_5 = Merge(Data1=flatten(displacement_i), Data2=flatten(energy_i), Data3=flatten(lenght_laths), Data4=flatten(no_joints))
edges_3 = BrepEdges(Brep=_12_patels_surf_straight)  # -> Naked, Interior, NonManifold
mesh_2 = Mesh(beamview.MeshesOfRenderedBeams)
panel_24 = Panel(merge_5)
panel_25 = Panel(merge)
panel_26 = Panel("""1.2D+ 1.2LL + 1.0W
(90mph only on tower)""")
item_8 = ListItem(List=panel_25, Index=0, Wrap=True)  # -> Item, Item1, Item2, Item3
item_9 = ListItem(List=panel_24, Index=0, Wrap=True)  # -> Item, Item1, Item2, Item3
sturnella = Sturnella(
    SturnellaChunkName_TotalElapsedTime=60369327992,
    SturnellaChunkName_DataDumpContraintGuid=bool,
    SturnellaChunkName_DataDumpObjectiveGuid=[displacement_i, energy_i, lenght_laths, no_joints],
    SturnellaChunkName_DataDumpParameterGuid=[r_bottom, r_top, asymptoticcount],
    SturnellaChunkName_OptimizationParams_OptimizationParams_HidePreview=False,
    SturnellaChunkName_OptimizationParams_OptimizationParams_Hours=0,
    SturnellaChunkName_OptimizationParams_OptimizationParams_HypercubeFitnessDividend=10,
    SturnellaChunkName_OptimizationParams_OptimizationParams_IsTimeConstrained=False,
    SturnellaChunkName_OptimizationParams_OptimizationParams_Iterations=10,
    SturnellaChunkName_OptimizationParams_OptimizationParams_Minutes=0,
    SturnellaChunkName_OptimizationParams_OptimizationParams_MutationRate=0.5,
    SturnellaChunkName_OptimizationParams_OptimizationParams_PopulationSize=50,
    SturnellaChunkName_OptimizationParams_OptimizationParams_RepositorySize=250,
    SturnellaChunkName_OptimizationParams_OptimizationParams_SolutionSpaceDims=4,
    SturnellaChunkName_OptimizationParams_OptimizationParams_SolutionSpaceDivisors=10,
    SturnellaChunkName_Swarm_Swarm_CurrentIteration=10,
    SturnellaChunkName_Swarm_Swarm_CurrentParticle=0,
    SturnellaChunkName_Swarm_Swarm_CurrentSwarm=0,
    SturnellaChunkName_Swarm_Swarm_Particle0_Particle_CurrentSolution0_Solution_Hypercube=-1,
    SturnellaChunkName_Swarm_Swarm_Particle0_Particle_CurrentSolution0_Solution_Position=[0.7433744944, 0.1496788138, 7.532394399],
    SturnellaChunkName_Swarm_Swarm_Particle0_Particle_PersonalBest0_Solution_Hypercube=-1,
    SturnellaChunkName_Swarm_Swarm_Particle0_Particle_PersonalBest0_Solution_Feasible=[True, True],
    SturnellaChunkName_Swarm_Swarm_Particle0_Particle_PersonalBest0_Solution_Position=[1.213043081, 0.3746737354, 8.815222716],
    SturnellaChunkName_Swarm_Swarm_Particle0_Particle_PersonalBest0_Solution_Value=[3.446971109, 0.03638435185, 118.078701, 117],
    SturnellaChunkName_Swarm_Swarm_Particle1_Particle_CurrentSolution1_Solution_Hypercube=-1,
    SturnellaChunkName_Swarm_Swarm_Particle1_Particle_CurrentSolution1_Solution_Position=[1.377698008, 0.4959741925, 7.532394399],
    SturnellaChunkName_Swarm_Swarm_Particle1_Particle_PersonalBest1_Solution_Hypercube=-1,
    SturnellaChunkName_Swarm_Swarm_Particle1_Particle_PersonalBest1_Solution_Feasible=[True, True],
    SturnellaChunkName_Swarm_Swarm_Particle1_Particle_PersonalBest1_Solution_Position=[1.082645901, 0.3320377782, 16.33230966],
    SturnellaChunkName_Swarm_Swarm_Particle1_Particle_PersonalBest1_Solution_Value=[2.105842566, 0.04816541293, 206.7172925, 336]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)
python_3 = GhPythonScript(
    r=item_8.Item1,
    R=item_8.Item,
    h=item_8.Item2,
    d=item_9.Item,
    L=item_9.Item2,
    j=item_9.Item3,
    m=item_7.Item1,
    w=lathwidth_cm_2,
    t=number_slider_5,
    s=number_slider_2,
    lc=panel_26)  # -> out, a; inputs j: Int32
# ---------- python_3: Python ----------
__author__ = "judyt"
__version__ = "2023.05.10"

import rhinoscriptsyntax as rs


R = "Base R [m]: " + str(round(R,2))
r = "Top r [m]: "+  str(round(r,2))
h = "Height [m]: "+  str(round(h,2))
d = "Displ I [cm]: " + str(round(d,2))
L = "Lath Tot.Lenght [m]: " + str(round(L,2))
j = "Num of Joints: " + str(j)
w = "Lath width [cm]: " + str(w)
t = "Lath thickness [cm]: " + str(t)
s= "FEM segment lenght [m]: " + str(s)


data = [R,r,h,L,j, m,w,t,s,d,lc]
a = ""

for i in range(len(data)):
    print type(data[i])
    a = a + data[i]+ "\n"
# ---------- end python_3 ----------
panel_27 = Panel("""1/300

600/300 = 2cm

1/150

600/150 = 4cm""")
smaller_2 = SmallerThan(FirstNumber=displacement_i, SecondNumber=Slider(4, range=0..10))  # -> SmallerThan, OrEqualTo
bool = Boolean(smaller_2.SmallerThan)
pt_6 = ConstructPoint(XCoordinate=0, YCoordinate="-3", ZCoordinate=0)
tag = TextTag3D(Location=pt_6, Text=python_3.a, Size=Slider(0.2, range=0..1), Justification=5)

# ==== cluster KarambaBeams
ldist = ClusterInput()
srf = ClusterInput()
lines = ClusterInput()
id = ClusterInput()
lines_2 = Line(flatten(lines))
srf_2 = Surface(reparameterize(srf))
# beams
id_2 = Data(id)
curvepoint = PointOnCurve(lines_2, parameter=0.5)
srf_cp = SurfaceClosestPoint(Point=curvepoint, Surface=srf_2)  # -> Point, UVPoint, Distance
evalsrf = EvaluateSurface(Surface=srf_2, Point=srf_cp.UVPoint)  # -> Point, Normal, UDirection, VDirection, Frame
nor_vect = Vector(evalsrf.UDirection)
linetobeam = LineToBeamKaramba3D(
    Line=lines_2,
    Identifier=id_2,
    New=True,
    Remove=True,
    LimitDistance_m=ldist,
    ZOrientation=nor_vect,
    Bending=Toggle(True),
    SetBucklingLength=True,
    ToPolylineMaxAngle=0.03,
    ToPolylineTolerance=0.01,
    ToPolylineMaxEdgeLength=0.25)  # -> Element, Points, Info
element = ElementKaramba3D(linetobeam.Element)
element_2 = ClusterOutput(element)

# ==== cluster LoadCase0
factor = ClusterInput()
factor_2 = Number(factor)

# ----
# loads - LC0
panel = Panel("-1.0")
Z = UnitZ(Factor=panel)

multiplication = Multiplication(A=Z, B=factor_2)

loads = LoadsKaramba3D(Vector=multiplication, LCase="0", mode="Gravity")

lc0 = LoadKaramba3D(loads)
lc0_2 = ClusterOutput(lc0)

# ==== cluster LoadCase1
wind_pressure_kn_m2 = ClusterInput()
mesh_laths_for_wind = ClusterInput()
d_factor = ClusterInput()
w_factor = ClusterInput()
wind_pressure_kn_m2_2 = Number(wind_pressure_kn_m2)
mesh_laths_for_wind_2 = Mesh(mesh_laths_for_wind)
w_factor_2 = Number(w_factor)
d_factor_2 = Number(d_factor)
X = UnitX(Factor=wind_pressure_kn_m2_2)
Z = UnitZ(Factor="-1.0")
multiplication = Multiplication(A=X, B=w_factor_2)
multiplication_2 = Multiplication(A=Z, B=d_factor_2)

# ----
# loads - LC1
loads = LoadsKaramba3D(
    Vector=multiplication,
    Mesh=mesh_laths_for_wind_2,
    LCase="1",
    mode="MeshLoad -Const.",
    menu=[buttons(off, off, on), buttons(on, on)])
loads_2 = LoadsKaramba3D(Vector=multiplication_2, LCase="1", mode="Gravity")

lc1 = LoadKaramba3D(flatten([loads_2, loads]))
lc1_2 = ClusterOutput(lc1)

# ==== cluster KarambaMaterial
material_data_tree = ClusterInput()
material_data_tree_2 = Data(material_data_tree)
matselect = MaterialSelectionKaramba3D(menu=[dropdown(4), dropdown(1)])

# ----
# material definition
bang = ExplodeTree(Data=material_data_tree_2)  # -> Branch0, Branch1, Branch2, Branch3, Branch4, Branch5, Branch6
shear_modulus_kn_cm2 = Number(bang.Branch2)
youngs_modulus_kn_cm2 = Number(bang.Branch0)
density_kn_m3 = Number(bang.Branch5)
poisson_ratio = Number(bang.Branch3)
radius_cm = Number(bang.Branch4)
fy_kn_cm2 = Number(bang.Branch6)
material_name = Text(bang.Branch1)

disassemble = DisassembleMaterialKaramba3D(Material=matselect)  # -> Material, TypeOfMaterial, FamilyNameOfMaterial, NameOfMaterial, ElemIdentifiers, Color, YoungsModulusKNCm2Dir12, InPlaneShearModulus_kN_cm2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
panel = Panel(material_name)
matprops = MaterialPropertiesKaramba3D(
    FamilyOfMaterial="wood",
    Name=panel,
    Color=disassemble.Color,
    YoungsModulus_kN_cm2="910",
    InPlaneShearModulus_kN_cm2=disassemble.InPlaneShearModulus_kN_cm2,
    TransverseShearModulus_kN_cm2=disassemble.TransverseShearModulusKNCm2Dir12,
    SpecificWeight_kN_m3="4.5",
    CoefficientOfThermalExpansion_1_C=disassemble.CoefficientOfThermalExpansion1CDir12,
    YieldStrength_kN_cm2=Slider(3.8, range=0..10),
    mode="Isotrop")
material = MaterialKaramba3D(matprops)
material_2 = ClusterOutput(material)

# ==== cluster CrossSection
lathwidth_cm = ClusterInput()
height_cm = ClusterInput()
id = ClusterInput()
id_2 = Data(id)
height_cm_2 = Number(height_cm)
lathwidth_cm_2 = Number(lathwidth_cm)
cross_section = CrossSectionKaramba3D(
    FamilyNameOfCrossSection="DefaultCroSec",
    ElementIdentifier=id_2,
    Material=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,
    Height_cm=height_cm_2,
    UpperFlangeWidth_cm=lathwidth_cm_2,
    LowerFlangeWidth_cm=lathwidth_cm_2,
    mode="Trapezoid")
crosec = CrossSectionKaramba3D(cross_section)
crosec_2 = ClusterOutput(crosec)

# ==== cluster LoadCase2
wind_pressure_kn_m2 = ClusterInput()
meshfor_wind = ClusterInput()
force_kn_val = ClusterInput()
node_pt = ClusterInput()
ll_factor = ClusterInput()
hangpoint = ClusterInput()
force_kn_dir = ClusterInput()
d_factor = ClusterInput()
w_factor = ClusterInput()
force_kn_val_2 = Number(force_kn_val)
wind_pressure_kn_m2_2 = Number(wind_pressure_kn_m2)
d_factor_2 = Number(d_factor)
w_factor_2 = Number(w_factor)
meshfor_wind_2 = Mesh(meshfor_wind)
node_pt_2 = Point(flatten(node_pt))
hangpoint_2 = Point(hangpoint)
ll_factor_2 = Number(ll_factor)
force_kn_dir_2 = Vector(force_kn_dir)
multiplication = Multiplication(A=force_kn_val_2, B=ll_factor_2)
X = UnitX(Factor=wind_pressure_kn_m2_2)
unit = UnitVector(Vector=force_kn_dir_2)
Z = UnitZ(Factor="-1.0")
multiplication_2 = Multiplication(A=X, B=w_factor_2)
amp = Amplitude(Vector=unit, Amplitude=multiplication)
multiplication_3 = Multiplication(A=Z, B=d_factor_2)
fsim = FindSimilarMember(Data=hangpoint_2, Set=node_pt_2)  # -> Hit, Index

# ----
# loads - LC3
# gravity+ hanging petals+ wind (tower +petals)
loads = LoadsKaramba3D(Vector=multiplication_3, LCase="3", mode="Gravity")
loads_2 = LoadsKaramba3D(ForceVector=amp, Local=False, PosInd=fsim.Hit, LCase="3", mode="Point")

# ----
# wind
loads_3 = LoadsKaramba3D(
    Vector=multiplication_2,
    Mesh=meshfor_wind_2,
    LCase="3",
    mode="MeshLoad -Const.",
    menu=[buttons(off, off, on), buttons(on, on)])

lc3 = LoadKaramba3D(flatten([loads_2, loads, loads_3]))
lc3_2 = ClusterOutput(lc3)
